# Grasshopper definition ABBDemo.gh (Grasshopper 0.9.76)
# plug-ins: HAL for Grasshopper

panel = Panel("2000")
panel_2 = Panel("-50")
panel_3 = Panel("200")
panel_4 = Panel("1")
panel_5 = Panel("0")
panel_6 = Panel("0")
panel_7 = Panel("0")
quaternion_frame = QuaternionFrame(
    X=panel,
    Y=panel_2,
    Z=panel_3,
    Qw=panel_4,
    Qx=panel_5,
    Qy=panel_7,
    Qz=panel_6,
    _0_0=panel,
    _1_0=panel_2,
    _2_0=panel_3,
    _3_0=panel_4,
    _4_0=panel_5,
    _5_0=panel_7,
    _6_0=panel_6,
    template="Quaternion Frame")
rotate = Rotate(Geometry=quaternion_frame, Angle=degrees(Slider(0, range=-180..80)), Plane=quaternion_frame)  # -> Geometry, Transform
panel_8 = Panel("Table")
reference = Reference(Alias=panel_8, Frame=rotate.Geometry, _0_0=panel_8, _1_0=rotate)

panel_9 = Panel("DO_01")
digital_output = DigitalOutput(
    Alias=panel_9,
    Low=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,
    High=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,
    Default=False,
    _0_0=panel_9,
    template="Digital Signal")

do_01 = ElectricSignal(digital_output)
table = Part(reference)

# ---- group: FollowCurveOrientedTowardsRobot
number_slider = Slider(15, range=0..100)
crv = Curve(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)
target = Target(
    Alias="Curve",
    Curve=crv,
    Discretization={halEnum=1, halEnumType="CurveDiscretization"},
    Tolerance=number_slider,
    IsAbsolute=True,
    _1_0=crv,
    _3_0=number_slider,
    template="From Curve")  # -> Object_Target, Trace
target_2 = Target(Target=target.Object_Target, _0_0=target, template="Get Properties")  # -> Alias, Object_Joint, WayFrame, EndFrame, Reference, IsArc
xy = XYPlane(Origin=Point(0, 0, 0))
vec2pt = Vector2Pt(PointA=xy, PointB=target_2.EndFrame, Unitize=False)  # -> Vector, Length
parallel = Parallel(
    Target=target.Object_Target,
    Direction=vec2pt.Vector,
    Axis={halEnum=0, halEnumType="Axis"},
    Flip=True,
    Project=False,
    _0_0=target,
    _2_0=vec2pt,
    template="Align Parallel to vector")
move = Move(Object_Target=parallel, _1_0=parallel, template="Follow Targets")

# ---- group: FollowCurveOnReference
number_slider_2 = Slider(10, range=0..10)
number_slider_3 = Slider(360, range=0..1000)
number_slider_4 = Slider(15, range=0..100)
cir = Circle(Plane=PlaneXY(0, 0, 0), Radius=Slider(200, range=0..1000))
blend = Blend(Position=number_slider_2, _1_0=number_slider_2)
speed = Speed(Position=number_slider_3, _1_0=number_slider_3)
table_2 = Part(table)
crv_2 = Curve(cir)
target_3 = Target(
    Alias="Curve",
    Curve=crv_2,
    Discretization={halEnum=1, halEnumType="CurveDiscretization"},
    Tolerance=number_slider_4,
    Reference=table_2,
    IsAbsolute=False,
    _1_0=crv_2,
    _3_0=number_slider_4,
    _4_0=table_2,
    template="From Curve")  # -> Object_Target, Trace
motion_settings = MotionSettings(Space={halEnum=0, halEnumType="MotionSpace"}, Speed=speed, Blend=blend, _2_0=speed, _4_0=blend)
crv_3 = Curve(target_3.Trace)
move_2 = Move(
    Object_Target=target_3.Object_Target,
    Object_Settings=motion_settings,
    _1_0=target_3,
    _2_0=motion_settings,
    template="Follow Targets")

# ---- group: Wait Time
number_slider_5 = Slider(0.5, range=0..1)
wait = Wait(Alias="Wait", Duration=number_slider_5, _1_0=number_slider_5)

# ---- group: Reset Signal
toggle = BooleanToggle(False)
do_01_2 = ElectricSignal(do_01)
digital_state = DigitalState(
    Signal=do_01_2,
    Effect={halEnum=1, halEnumType="SignalEffect"},
    State=toggle,
    _1_0=do_01_2,
    _3_0=toggle,
    template="Digital State")

# ---- group: Set Signal
toggle_2 = BooleanToggle(True)
do_01_3 = ElectricSignal(do_01)
digital_state_2 = DigitalState(
    Signal=do_01_3,
    Effect={halEnum=1, halEnumType="SignalEffect"},
    State=toggle_2,
    _1_0=do_01_3,
    _3_0=toggle_2,
    template="Digital State")

# ----
do_01_4 = ElectricSignal(do_01)
panel_10 = Panel("IRC5")
irc5 = ExecutionControl(Loop=False, TimeRatio=1)

cone = Cone(Base=PlaneXY(0, 0, 0), Radius=Slider(100, range=0..100), Length=Slider(200, range=0..1000))  # -> Cone, Tip
xy_2 = XYPlane(Origin=cone.Tip)
panel_11 = Panel("Cone")

mesh = MeshBrep(
    Brep=cone.Cone,
    Settings={GridMaxCount=0, GridMinCount=16, JaggedSeams=False, MaxEdgeLength=0, MinEdgeLength=0.0001, MinTolerance=0, Refine=True, RefineAngle=0, RelativeTolerance=0.65, SimplePlanes=True, Tolerance=0})
xy_3 = XYPlane(Origin=Point(0, 0, 0))
robot = Robot(Alias="Robot", catalogItem="Mechanism,fd088ba8-9e88-4d04-be49-4663db7edd0a", tags="Manipulator")

tool = Tool(
    Alias=panel_11,
    Frame=xy_3,
    Object_Body=mesh,
    ToolFrame=xy_2,
    _0_0=panel_11,
    _1_0=xy_3,
    _2_0=mesh,
    _4_0=xy_2,
    template="Generic Tool")

attach = Attach(
    Alias="Composite Mechanism",
    Parent=robot,
    Child=tool,
    IsEndEffector=True,
    Location=Plane(origin=(-1.234321012e+308, -1.234321012e+308, -1.234321012e+308), x=(0, 0, 0), y=(0, 0, 0)),
    FromWorld=True)

robottoolcombo = Mechanism(attach)

# ---- group: JointMove
speed_2 = Speed()
acceleration = Acceleration()
blend_2 = Blend()
robottoolcombo_2 = Mechanism(robottoolcombo)
merge = Merge(
    Data1=Slider(-1, range=-180..180),
    Data2=Slider(17, range=-180..180),
    Data3=Slider(-14, range=-180..180),
    Data4=Slider(13, range=-180..180),
    Data5=Slider(40, range=-180..180),
    Data6=Slider(0, range=-180..180))  # -> flatten(Result)
space = Space({halEnum=1, halEnumType="MotionSpace"})
rad = Radians(Degrees=merge)
motion_settings_2 = MotionSettings(
    Space=space,
    Speed=speed_2,
    Acceleration=acceleration,
    Blend=blend_2,
    _1_0=space,
    _2_0=speed_2,
    _3_0=acceleration,
    _4_0=blend_2)
target_4 = Target(Mechanism=robottoolcombo_2, Object_Position=rad, _1_0=robottoolcombo_2, _2_0=rad, template="From Joint Positions")
move_3 = Move(
    Object_Target=target_4,
    Object_Settings=motion_settings_2,
    _1_0=target_4,
    _2_0=motion_settings_2,
    template="Follow Targets")

robottoolcombo_3 = Mechanism(robottoolcombo)
merge_2 = Merge(
    Data1=Slider(15, range=-180..180),
    Data2=Slider(-1, range=-180..180),
    Data3=Slider(10, range=-180..180),
    Data4=Slider(11, range=-180..180),
    Data5=Slider(46, range=-180..180),
    Data6=Slider(0, range=-180..180))  # -> flatten(Result)
rad_2 = Radians(Degrees=merge_2)
target_5 = Target(Mechanism=robottoolcombo_3, Object_Position=rad_2, _1_0=robottoolcombo_3, _2_0=rad_2, template="From Joint Positions")
motion_settings_3 = MotionSettings(Space={halEnum=1, halEnumType="MotionSpace"})
move_4 = Move(
    Object_Target=target_5,
    Object_Settings=motion_settings_3,
    _1_0=target_5,
    _2_0=motion_settings_3,
    template="Follow Targets")

# ----
merge_3 = Merge(
    Data1=flatten(move_3),
    Data2=flatten(move),
    Data3=flatten(digital_state_2),
    Data4=flatten(wait),
    Data5=flatten(digital_state),
    Data6=flatten(move_2),
    Data7=flatten(move_4))
combine = Combine(Object_Combined=merge_3, Compact=True, _1_0=merge_3)
robottoolcombo_4 = Mechanism(robottoolcombo)
controller = Controller(
    Alias=panel_10,
    Object_Robot=robottoolcombo_4,
    Object_Procedure=combine,
    Object_Signal=do_01_4,
    _0_0=panel_10,
    _2_0=robottoolcombo_4,
    _3_0=combine,
    _4_0=do_01_4,
    catalogItem="Controller,c391cd57-4094-4b53-9bc4-fc3816805551",
    tags="Controller")

panel_12 = Panel("C:\HAL\RAPID")
toggle_3 = BooleanToggle(False)
export = Export(Controller=controller, Destination=panel_12, Export=toggle_3, _0_0=controller, _1_0=panel_12, _2_0=toggle_3)

panel_13 = Panel("192.168.125.1")
toggle_4 = BooleanToggle(False)
upload = Upload(
    Controller=controller,
    NetworkId=panel_13,
    Mode={halEnum=0, halEnumType="DeclarationMode"},
    AutoRun=False,
    Upload=toggle_4,
    _0_0=controller,
    _1_0=panel_13,
    _6_0=toggle_4)

solver = ProcedureSolver(Controller=controller, Solve=Toggle(True))  # -> Solution, Object_Solved, Notification
execute = Execute(
    ExecutionControl=irc5,
    Solution=solver.Solution,
    displayEnvironment=True,
    displayMechanisms=True,
    displayTrace=True,
    realTime=False)  # -> ExecutedActions, State, Object_Notification
